# Grasshopper definition SampleFile.gh (Grasshopper 1.0.8)
# plug-ins: MarkerBasedAR

point = Point(Point(0, 0, 0))
curve = Curve(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)
curve_2 = Curve(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)
point_2 = Point(Point(400, 0, 0))
curve_3 = Curve(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)
curve_4 = Curve(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)
# 1. Fiducial Marker
construct_plane = ConstructPlane(Origin=point, XAxis=curve, YAxis=curve_2)
construct_plane_2 = ConstructPlane(Origin=point_2, XAxis=curve_3, YAxis=curve_4)

# ----
# The position and orientation of fiducial markers
merge = Merge(Data1=construct_plane, Data2=construct_plane_2)

# ----
# Dictionary, size and index of markers.
list_length = ListLength(List=merge)
starting_index = Panel("0")
markerdictionary = MarkerDictionary({"Dict4X4_50": "0", "Dict4X4_100": "1", "Dict4X4_250": "2", "Dict4X4_1000": "3", "Dict5X5_50": "4", "Dict5X5_100": "5", "Dict5X5_250": "6", "Dict5X5_1000": "7", "Dict6X6_50": "8", "Dict6X6_100": "9", "Dict6X6_250": "10", "Dict6X6_1000": "11", "Dict7X7_50": "12", "Dict7X7_100": "13", "Dict7X7_250": "14", "Dict7X7_1000": "15", "DictArucoOriginal": "16", "DictAprilTag_16h5(30)": "17", "DictAprilTag_25h9(35)": "18", "DictAprilTag_36h10(2320)": "19", "DictAprilTag_36h11(587)": "20"}, selected="Dict4X4_50")
series = Series(Start=starting_index, Step=1, Count=list_length)
size_of_markers_unit_mm = Slider(120, range=0..1000)
getmarker2dbitarray = GetMarker2DBitArray(DictionaryName=markerdictionary, MarkerID=series)  # -> Marker2DArray, SidePixels
marker2dbitarrayto2dhatch = Marker2DBitArrayTo2DHatch(
    Marker2DArray=getmarker2dbitarray.Marker2DArray,
    SidePixels=getmarker2dbitarray.SidePixels,
    SideLength=size_of_markers_unit_mm)
group = Group(Objects=marker2dbitarrayto2dhatch)  # -> flatten(Group)
orient = Orient(Geometry=group, Source=PlaneXY(0, 0, 0), Target=merge)  # -> Geometry, Transform

# ----
# 2. Camera
# Camera Streaming
webcamstream = WebcamStream()  # disabled

# ----
# 3. Pose Estimation
# Pose Estimation of Markers
file_path = FilePath()
arucomarkerdetector = ArucoMarkerDetector(CaliFileFolderPath=file_path, Image=webcamstream, Dictionary=markerdictionary, MarkerSize=size_of_markers_unit_mm)  # -> MarkerIndex, Plane, Image, Marker_Matrix
plane = Plane(arucomarkerdetector.Plane)
distance = Distance(PointA=plane, PointB="{0,0,0}")
sort_list = SortList(Keys=distance, ValuesValuesA=arucomarkerdetector.MarkerIndex, ValuesA=arucomarkerdetector.Marker_Matrix)  # -> Keys, ValuesValuesA, ValuesA
list_item = ListItem(List=sort_list.ValuesValuesA, Index=0, Wrap=True)
list_item_2 = ListItem(List=sort_list.ValuesA, Index=0, Wrap=True)

# ----
# Camera Calibration
webcamcalibration = WebcamCalibration()  # disabled

relay = Relay()

# ---- group: Camera Model
mesh = Mesh(<mesh referenced from the Rhino model>)

# ----
# Calculate the pose of Real Camera in the World Coordination System
matrix = Matrix(list_item_2)
create_set = CreateSet(List=series)  # -> Set, Map
integer = Integer(create_set.Set)
integer_2 = Integer(relay)
member_index = MemberIndex(Set=integer, Member=integer_2)  # -> Index, Count
list_item_3 = ListItem(List=orient.Transform, Index=member_index.Index, Wrap=True)

# ----
# Cam to World
# Cam to Marker
# Marker to World
invert_matrix = InvertMatrix(Matrix=matrix, Tolerance=0)  # -> Matrix, Success
matrix_2 = Matrix(list_item_3)
multiplication = Multiplication(A=matrix_2, B=invert_matrix.Matrix)

matrix_3 = Matrix(multiplication)

# ----
# 4. Image Overlay
# Create a Rhino Viewport, Adjust the pose in the Rhino Viewport.
# Set a Display mode named "AR_Technical" based on the technical display mode.
matrix2plane = Matrix2Plane(Matrix=matrix_3)
deconstruct_plane = DeconstructPlane(Plane=matrix2plane)  # -> Origin, XAxis, YAxis, ZAxis
createarviewport = CreateARViewport(
    Button=Button(),
    Viewport_Name="AR_View01",
    ARDisplayMode_Name="AR_Technical",
    Width="1024",
    Height="768",
    AdjustmentInWidth="18",
    AdjustmentInHeight="47")  # -> AR_RhinoView, Viewport_names, DisplayMode_Names
line_sdl = LineSDL(Start=deconstruct_plane.Origin, Direction=deconstruct_plane.ZAxis, Length="300")
end_points = EndPoints(Curve=line_sdl)  # -> Start, End
getmainviewport = GetMainViewport(RhinoView=createarviewport.AR_RhinoView)
vector = Vector(deconstruct_plane.YAxis)
negative = Negative(Value=vector)
point_3 = Point(deconstruct_plane.Origin)
point_4 = Point(end_points.End)
setviewportcamera = SetViewportCamera(
    MainViewport=getmainviewport,
    CameraLocation=point_3,
    CameraTarget=point_4,
    CameraUP=negative,
    FocalLength=Slider(26, range=16..105))

# ----
# Image Overlay
trigger = Trigger(Interval=50, TimerInterval=50, Target=getbmpfromrhinoview)  # disabled
overlay_proportion_solid_proportion = Slider(0.5, range=0..1)
shift_in_horizontal_direction = Slider(-18, range=-100..100)
shift_in_vertical_direction = Slider(-47, range=-100..100)
getbmpfromrhinoview = GetBmpFromRhinoView(RhinoView=createarviewport.AR_RhinoView)
matmovepixels = MatMovePixels(Bitmap=getbmpfromrhinoview, Vertical=shift_in_vertical_direction, Horizontal=shift_in_horizontal_direction)
subtraction = Subtraction(A="1", B=overlay_proportion_solid_proportion)
bitmapoverlay = BitmapOverlay(Image_1=webcamstream, Weight_1=overlay_proportion_solid_proportion, Image_2=matmovepixels, Weight_2=subtraction)
bitmappreview = BitmapPreview(Bitmap=bitmapoverlay)

query_viewports = QueryViewports(Name="AR_View01", AutoUpdateState=True)
model_view = ModelView(View=query_viewports)  # -> View, Title, Perspective, Location, Target, XExtents, YExtents, ZExtents
deconstruct_domain = DeconstructDomain(Domain=model_view.ZExtents)  # -> Start, End
view = View(model_view.View, ViewSource=1)
deconstruct_plane_2 = DeconstructPlane(Plane=view)  # -> Origin, XAxis, YAxis, ZAxis
negative_2 = Negative(Value=deconstruct_domain.Start)
amplitude = Amplitude(Vector=deconstruct_plane_2.ZAxis, Amplitude=negative_2)
construct_plane_3 = ConstructPlane(Origin=deconstruct_plane_2.Origin, XAxis=deconstruct_plane_2.XAxis, YAxis=deconstruct_plane_2.YAxis)
move = Move(Geometry=construct_plane_3, Motion=amplitude)  # -> Geometry, Transform
rectangle = Rectangle(Plane=move.Geometry, XSize=model_view.XExtents, YSize=model_view.YExtents, Radius=0)  # -> Rectangle, Length
brep_edges = BrepEdges(Brep=rectangle.Rectangle)  # -> Naked, Interior, NonManifold
angle = Angle(VectorA=brep_edges.Naked, VectorB=deconstruct_plane_2.YAxis)  # -> Angle, Reflex
subtraction_2 = Subtraction(A=angle.Angle, B=1.570796327)
absolute = Absolute(Value=subtraction_2)
larger_than = LargerThan(FirstNumber=absolute, SecondNumber="0.001")  # -> LargerThan, OrEqualTo
dispatch = Dispatch(List=brep_edges.Naked, DispatchPattern=larger_than.LargerThan)  # -> ListA, ListB
list_item_4 = ListItem(List=dispatch.ListA, Index=0, Wrap=True)  # -> Item, Item1
curve_middle = CurveMiddle(Curve=list_item_4.Item)
curve_middle_2 = CurveMiddle(Curve=list_item_4.Item1)
line = Line(StartPoint=construct_plane_3, EndPoint=curve_middle)
line_2 = Line(StartPoint=construct_plane_3, EndPoint=curve_middle_2)
annotation_text_settings = AnnotationTextSettings(TextHeight=Slider(10, range=0..10))
angle_dimension_lines = AngleDimensionLines(LineA=line, LineB=line_2, TextSettings=annotation_text_settings)  # -> AngleDimension, LineA, LineB, DimensionLocation

# ----
# Display the name, pose and view of real Camera in Rhino Viewport.
point_5 = Point(<point referenced from the Rhino model>)
curve_5 = Curve(<curve referenced from the Rhino model>)
curve_6 = Curve(<curve referenced from the Rhino model>)
unit_z = UnitZ(Factor=Slider(41, range=0..100))
deconstruct_plane_3 = DeconstructPlane(Plane=matrix2plane)  # -> Origin, XAxis, YAxis, ZAxis
move_2 = Move(Geometry=deconstruct_plane_3.Origin, Motion=unit_z)  # -> Geometry, Transform
annotation_dot = AnnotationDot(Location=move_2.Geometry, PrimaryText="Camera")  # -> AnnotationDot, Location, PrimaryText, TextHeight

# ---- group: Camera Original Pose
construct_plane_4 = ConstructPlane(Origin=point_5, XAxis=curve_5, YAxis=curve_6)

# ----
orient_2 = Orient(Geometry=mesh, Source=construct_plane_4, Target=matrix2plane)  # -> Geometry, Transform
